# Grasshopper definition Psychrometric_Chart.gh (Grasshopper 1.0.7)

panel = Panel("https://www.energyplus.net/weather-download/north_and_central_america_wmo_region_4/USA/NY/USA_NY_New.York-J.F.Kennedy.Intl.AP.744860_TMY3/all")
epw_stat = Ladybug_OpenEPWAndSTATWeatherFiles(weatherFileURL=panel)  # -> epwFile, statFile; plug-in component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
importepw = Ladybug_ImportEpw(epwFile=epw_stat.epwFile)  # -> readMe, latitude, location, dryBulbTemperature, dewPointTemperature, relativeHumidity, windSpeed, windDirection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; plug-in component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

# ----
# Import Weather Data
ladybug = Ladybug_Ladybug()  # -> Vviiiiiiiiiizzz; plug-in component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
pmvcomfortpar = Ladybug_PMVComfortParameters(humidRatioUpBound="0.012")  # -> comfortPar; plug-in component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
panel_2 = Panel("""0.6
1""")
# Create Psychrometric Chart
psychchart = Ladybug_PsychrometricChart(
    dryBulbTemperature=importepw.dryBulbTemperature,
    relativeHumidity=importepw.relativeHumidity,
    barometricPressure=importepw.barometricPressure,
    clothingLevel=panel_2,
    mergeComfPolygons=Toggle(True),
    comfortPar=pmvcomfortpar,
    runIt=Toggle(True))  # -> readMe, port, totalComfortPercent, totalComfortOrNot, strategyNames, strategyPercentOfTime, strategyOrNot, port_2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; plug-in component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
panel_3 = Panel(psychchart.readMe)
panel_4 = Panel(psychchart.totalComfortPercent)
preview = CustomPreview(
    Geometry=[psychchart.chartCurvesAndTxt, psychchart.comfortPolygons, psychchart.strategyPolygons],
    Shader=ColourSwatch(SwatchColor=RGB(0, 0, 0)))

pt = ConstructPoint(XCoordinate=500, YCoordinate=0, ZCoordinate=0)
# See When Comfortable Hours Occur
panel_5 = Panel("0.25")
_3dchart = Ladybug_3DChart(inputData=flatten(psychchart.totalComfortOrNot), basePoint=pt, xScale=panel_5, zScale="0")  # -> readMe, graphMesh, graphCurves, legend, legendBasePts, title, titleBasePts, dataPts, conditionalHOY; plug-in component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
preview_2 = CustomPreview(Geometry=[_3dchart.graphCurves, _3dchart.legend], Shader=ColourSwatch(SwatchColor=RGB(0, 0, 0)))
