# Grasshopper definition Wind_Rose.gh (Grasshopper 1.0.5)

panel = Panel("https://www.energyplus.net/weather-download/north_and_central_america_wmo_region_4/USA/VA/USA_VA_Arlington-Ronald.Reagan.Washington.Natl.AP.724050_TMY3/all")
ladybug = Ladybug_Ladybug()  # -> Vviiiiiiiiiizzz; plug-in component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
panel_2 = Panel("""Ladybug
LBExampleFiles
Wind Rose""")
path = FilePath("C:\EnergyPlusV8-3-0\WeatherData\USA_IL_Chicago-OHare.Intl.AP.725300_TMY3.epw")
panel_3 = Panel(path)
panel_4 = Panel(ladybug)
exporthydra = Hydra_ExportFile(
    fileName="Wind Rose",
    fileDescription="This example shows how to draw a wind rose with Ladybug",
    fileTags=panel_2,
    export=Toggle(False))  # -> readMe; inputs fileDescription: list, changeLog: list, fileTags: list, includeRhino: Boolean, GHForThumb: Boolean, additionalImgs: list, export: Boolean; plug-in component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
epw_stat = Ladybug_OpenEPWAndSTATWeatherFiles(weatherFileURL=panel)  # -> epwFile, statFile; plug-in component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
panel_5 = Panel(epw_stat.epwFile)
open_weather_file = Ladybug_OpenEPWWeatherFile(open=Toggle(True))  # -> epwFile; plug-in component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
importepw = Ladybug_ImportEpw(epwFile=open_weather_file)  # -> readMe, latitude, location, dryBulbTemperature, dewPointTemperature, relativeHumidity, windSpeed, windDirection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; plug-in component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
gradientlibrary = Ladybug_GradientLibrary(gradIndex="8")  # -> customColors; plug-in component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
panel_6 = Panel(importepw.dryBulbTemperature)
legendpar = Ladybug_LegendParameters(highBound="9", customColors=flatten(gradientlibrary))  # -> legendPar; plug-in component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
toggle = BooleanToggle(True)
windrose = Ladybug_WindRose(
    north=0,
    hourlyWindDirection=importepw.windDirection,
    hourlyWindSpeed=importepw.windSpeed,
    showFrequency=toggle,
    showAverageVelocity=toggle,
    legendPar=legendpar,
    runIt=Toggle(True))  # -> readMe, calmRoseMesh, windRoseMesh, windRoseCrvs, windRoseCenPts, legend, legendBasePts, title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; plug-in component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
