# Grasshopper definition Wind_Vertical_Profile.gh (Grasshopper 1.0.5)

# IMPORT WEATHER FILE
ladybug = Ladybug_Ladybug()  # -> Vviiiiiiiiiizzz; plug-in component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
panel = Panel("https://www.energyplus.net/weather-download/north_and_central_america_wmo_region_4/USA/IL/USA_IL_Chicago-OHare.Intl.AP.725300_TMY3/all")
epw_stat = Ladybug_OpenEPWAndSTATWeatherFiles(weatherFileURL=panel)  # -> epwFile, statFile; plug-in component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
open_weather_file = Ladybug_OpenEPWWeatherFile(open=Toggle(True))  # -> epwFile; plug-in component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
importepw = Ladybug_ImportEpw(epwFile=open_weather_file)  # -> readMe, latitude, location, dryBulbTemperature, dewPointTemperature, relativeHumidity, windSpeed, windDirection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; plug-in component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
importepw_2 = Ladybug_ImportEpw(epwFile=epw_stat.epwFile)  # -> readMe, latitude, location, dryBulbTemperature, dewPointTemperature, relativeHumidity, windSpeed, windDirection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; plug-in component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

# ----
# Use this to calculate annual wind
# speeds at any height
# (values are Rhino model units and
# you may want to adjust this)
number_slider = Slider(1, range=0..10)
# CALCULATE GROUND WIND SPEED FOR A YEAR
number_slider_2 = Slider(3, range=0..3)
windspeedcalculator = Ladybug_WindSpeedCalculator(windSpeed_tenMeters=importepw_2.windSpeed, terrainType=number_slider_2, heightAboveGround=number_slider)  # -> readMe, windSpeedAtHeight, windVectorAtHeight; plug-in component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
adjusted_ground_wind_speeds = Panel(windspeedcalculator.windSpeedAtHeight)

# ----
# VIZUALIZE AN ANNUAL AVERAGE WIND PROFILE
# Use these inputs to create a Wind Profile
# for a specific hour, analysis
# period, or for a natural ventilation
# period with the annualHourlyData_
# and the conditionalStatement_
# Use these inputs to change the
# display of the profile in relation to
# your architectural project, etc.
number_slider_3 = Slider(0, range=0..3)
windboundaryprofile = Ladybug_WindBoundaryProfile(windSpeed_tenMeters=importepw.windSpeed, windDirection=importepw.windDirection, terrainType=number_slider_3)  # -> readMe, port, windSpeeds, windVectors, vectorAnchorPts, port_2, windVectorMesh, windProfileCurve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; plug-in component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
preview = CustomPreview(
    Geometry=[windboundaryprofile.windProfileCurve, windboundaryprofile.legend, windboundaryprofile.profileAxes, windboundaryprofile.axesText],
    Shader=ColourSwatch(SwatchColor=RGB(0, 0, 0)))

# ----
# CREATE A WIND ROSE FOR THE GROUND WINDSPEED
windrose = Ladybug_WindRose(
    north=0,
    hourlyWindDirection=importepw_2.windDirection,
    hourlyWindSpeed=windspeedcalculator.windSpeedAtHeight,
    runIt=Toggle(True))  # -> readMe, calmRoseMesh, windRoseMesh, windRoseCrvs, windRoseCenPts, legend, legendBasePts, title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; plug-in component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
preview_2 = CustomPreview(Geometry=[windrose.windRoseCrvs, windrose.legend], Shader=ColourSwatch(SwatchColor=RGB(0, 0, 0)))
