# Grasshopper definition 人流模拟.gh (Grasshopper 1.0.5)
# plug-ins: Shortest Walk in Gh, ElkGHComponents

距离 = Slider(30, range=0..1000)
层次 = Slider(6, range=0..10)

宽容度 = Slider(3, range=0..100)
线条粗细 = Slider(3, range=0..10)

人流出发点 = Point([Point(348, 244, 0), Point(477, 297, 0), Point(553, 342, 0), Point(515, 364, 0), Point(489, 338, 0), Point(782, 243, 0), Point(845, 187, 0), Point(857, 535, 0), Point(892, 501, 0), Point(900, 516, 0)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])
陆地范围 = Curve(<curve referenced from the Rhino model>)

osm路径 = FilePath("E:\Work\大三\谷雨杯\010101.osm")

loc = Location(FilePathText=osm路径)  # -> OSMPointData, OSMFile, LongitudeDomain, LatitudeDomain
osm = OSMData(OSMPointData=loc.OSMPointData, OSMFilePath=loc.OSMFile, Feature="highway", Generate3d=False, IndividualOutputs=False)  # -> Ways, FeatureKey
prune = PruneTree(Tree=osm.Ways, Minimum=2, Maximum=0)
pline = PolyLine(Vertices=prune, Closed=False)
scale = Scale(Geometry=pline, Center=Point(0, 0, 0), Factor=0.0001)  # -> Geometry, Transform

bake路网 = Geometry(scale.Geometry)

道路分解 = Curve([<curve referenced from the Rhino model> x5000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])

series = Series(Start=距离, Step=距离, Count=层次)
cir = Circle(Plane=graft(人流出发点), Radius=series)  # -> graft(Circle)
rint = RegionIntersection(CurvesA=陆地范围, CurvesB=cir)  # -> simplify(Result)
path_mapper = PathMapper(rint, source="{a;b}", target="{b}")
boundary = BoundarySurfaces(Edges=path_mapper)
popgeo = PopulateGeometry(Geometry=boundary, Count=Slider(9, range=0..10), Seed=1)  # -> flatten(Population)
popgeo_2 = PopulateGeometry(Geometry=boundary, Count=Slider(10, range=0..10), Seed=Slider(12, range=0..100))  # -> flatten(Population)
cp = ClosestPoint(Point=popgeo, Cloud=popgeo_2)  # -> ClosestPoint, CPIndex, Distance
jitter = Jitter(List=cp.ClosestPoint, Jitter=Slider(0.01, range=0..0.01), Seed=2)  # -> Values, Indices
ln = Line(StartPoint=popgeo, EndPoint=jitter.Values)
shortwalk = ShortestWalk(Curves=道路分解, WantedPath=ln)  # -> ShortestWalk, Succession, Direction, Length
crv = Curve(shortwalk.ShortestWalk)
redpline = Reduce(Polyline=crv, Tolerance=宽容度)  # -> Polyline, Reduction
cp_2 = ControlPoints(Curve=redpline.Polyline)  # -> Points, Weights, Knots
pdecon = Deconstruct(Point=cp_2.Points)  # -> XComponent, YComponent, ZComponent
lng = ListLength(List=flatten(pdecon.XComponent))
lng_2 = ListLength(List=flatten(pdecon.YComponent))
dom = ConstructDomain(DomainStart=expr("-x", 线条粗细), DomainEnd=线条粗细)
random = Random(Range=dom, Number=lng, Seed=2)
random_2 = Random(Range=dom, Number=lng_2, Seed=Slider(5, range=0..10))
unflatten = UnflattenTree(Tree=random, Guide=pdecon.XComponent)
unflatten_2 = UnflattenTree(Tree=random_2, Guide=pdecon.YComponent)
addition = Addition(A=unflatten, B=pdecon.XComponent)
addition_2 = Addition(A=unflatten_2, B=pdecon.YComponent)
pt = ConstructPoint(XCoordinate=addition, YCoordinate=addition_2, ZCoordinate=0)

流线 = PolyLine(Vertices=pt, Closed=False)
