# Grasshopper definition 功能.gh (Grasshopper 1.0.5)
# plug-ins: Human, LunchBox

path = FilePath("E:\Work\大四上\居住区规划\Progress\最终图\LAYOUT\功能\ggg6.xlsx")
P = Plane(PlaneXY(0, 0, 0))
圆环半径 = Slider(150, range=0..1000)
父标题中点位置 = Slider(1, range=0..3)
父标题弦长 = Slider(0.85, range=0..1)
父标题间隔 = Slider(0.1, range=0..1)
父标题间隔_2 = Slider(1, range=0..5)

excelread = ExcelReader(ReadExcelData=Toggle(True), WorkbookPath=path, WorksheetName="Sheet1")  # -> Exceptions, ExcelData
rad = Radians(Degrees=Slider(180, range=0..1000))
cir = Circle(Plane=P, Radius=圆环半径)
subtraction = Subtraction(A=父标题中点位置, B=父标题弦长)
rotate = Rotate(Geometry=cir, Angle=rad, Plane=PlaneXY(0, 0, 0))  # -> Geometry, Transform
tstat = TreeStatistics(Tree=excelread.ExcelData)  # -> Paths, Length, Count
shatter = Shatter(Curve=reparameterize(rotate.Geometry), Parameters=[父标题弦长, subtraction])
item = ListItem(List=excelread.ExcelData, Index="0", Wrap=True)  # -> flatten(Item)
panel = Panel(item)
tstat_2 = TreeStatistics(Tree=excelread.ExcelData)  # -> Paths, Length, Count
item_2 = ListItem(List=shatter, Index=0, Wrap=True)  # -> Item, Item1
item_3 = ListItem(List=tstat.Paths, Index="1", Wrap=True)
item_4 = ListItem(List=tstat_2.Paths, Index="2", Wrap=True)
branch = TreeBranch(Tree=excelread.ExcelData, Path=item_3, MaintainPaths=True)
subtraction_2 = Subtraction(A=父标题间隔_2, B=父标题间隔)
crv = Curve(item_2.Item1)
branch_2 = TreeBranch(Tree=excelread.ExcelData, Path=item_4, MaintainPaths=True)
dom = ConstructDomain(DomainStart=父标题间隔, DomainEnd=subtraction_2)
cull_i = CullIndex(List=branch, Indices="0", Wrap=True)
panel_2 = Panel(cull_i)
subcrv = SubCurve(BaseCurve=reparameterize(crv), Domain=dom)
cull_i_2 = CullIndex(List=branch_2, Indices="0", Wrap=True)
panel_3 = Panel(cull_i_2)
split = TextSplit(Text=cull_i, Separators="/")
panel_4 = Panel(split)
lng = ListLength(List=cull_i_2)
item_5 = ListItem(List=split, Index=0, Wrap=True)  # -> flatten(Item)
cset = CreateSet(List=item_5)  # -> Set, Map
panel_5 = Panel(cset.Set)
divide = DivideCurve(Curve=item_2.Item, Count=expr("x-1", lng), Kinks=False)  # -> Points, Tangents, Parameters
mindex = MemberIndex(Set=item_5, Member=cset.Set)  # -> Index, Count
panel_6 = Panel(mindex.Count)
pt = ConstructPoint(XCoordinate=0, YCoordinate=0, ZCoordinate=0)
lng_2 = ListLength(List=cset.Set)
divide_2 = DivideCurve(Curve=subcrv, Count=expr("x-1", lng_2), Kinks=False)  # -> Points, Tangents, Parameters
ln = Line(StartPoint=pt, EndPoint=divide.Points)
line = LineSDL(Start=divide.Points, Direction=ln, Length=1)
pt_2 = ConstructPoint(XCoordinate=0, YCoordinate=0, ZCoordinate=0)
pi = Pi(Factor="0.5")
ln_2 = Line(StartPoint=pt_2, EndPoint=divide_2.Points)
rotate_2 = Rotate(Geometry=line, Angle=pi, Plane=divide.Points)  # -> Geometry, Transform
item_6 = ListItem(List=line, Index=mindex.Index, Wrap=True)  # -> simplify(Item)
line_2 = LineSDL(Start=divide_2.Points, Direction=ln_2, Length=1)
pi_2 = Pi(Factor="0.5")
lnln = LineLine(LineA=line, LineB=rotate_2.Geometry)
rotate_3 = Rotate(Geometry=line_2, Angle=pi_2, Plane=divide_2.Points)  # -> Geometry, Transform
range = Range(Domain=Domain(0, 1), Steps=expr("x-1", lng_2))
line_3 = Line(simplify(graft(line_2)))
lnln_2 = LineLine(LineA=line_2, LineB=rotate_3.Geometry)
gradient = Gradient(LowerLimit=0, UpperLimit=1, Parameter=range, stops=[0.15: RGB(255, 130, 160), 0.85: RGB(220, 0, 40)])
flip = FlipCurve(Curve=line_3)  # -> Curve, Flag

张力大小 = Slider(1.14, range=0..11)
张力大小_2 = Slider(0.3, range=0..1)

ladybug = Ladybug_Ladybug()  # -> Vviiiiiiiiiizzz; plug-in component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

gradientlibrary = Ladybug_GradientLibrary(gradIndex=Slider(19, range=0..23))  # -> customColors; plug-in component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

线条粗细 = Slider(0.79, range=0..10)
绝对粗细 = BooleanToggle(True)
父标题字号 = Slider(5, range=0..10)
子标题字号 = Slider(3.12, range=0..10)
子标题颜色 = ColourSwatch(SwatchColor=RGB(0, 0, 0))

blendc = BlendCurve(CurveA=flip.Curve, CurveB=item_6, BulgeA=张力大小, BulgeB=张力大小_2, Continuity=2)
relay = Relay([ColourSwatch(SwatchColor=RGB(86, 203, 232)), ColourSwatch(SwatchColor=RGB(94, 181, 224)), ColourSwatch(SwatchColor=RGB(178, 235, 197)), ColourSwatch(SwatchColor=RGB(255, 227, 125)), ColourSwatch(SwatchColor=RGB(255, 178, 153)), ColourSwatch(SwatchColor=RGB(250, 142, 168)), ColourSwatch(SwatchColor=RGB(236, 201, 245)), ColourSwatch(SwatchColor=RGB(245, 201, 201))])

previewlw = CustomPreviewLineweights(Geometry=blendc, Shader=graft(relay), Thickness=线条粗细, Absolute=绝对粗细)
tag = TextTag3D(Location=lnln_2, Text=cset.Set, Size=父标题字号, Colour=relay, Justification=4)
tag_2 = TextTag3D(Location=lnln, Text=cull_i_2, Size=子标题字号, Colour=子标题颜色, Justification=4)
