# Grasshopper definition 地形.gh (Grasshopper 1.0.5)
# plug-ins: Human

mesh地形 = Mesh()
等高线宽度 = Slider(4, range=0..10)
等高线高差 = Slider(0.05, range=0..1)

# ----
# 等高线
contour = Contour(Shape=mesh地形, Point=Point(0, 0, 0), Direction=Vector(0, 0, 1), Distance=等高线高差)  # -> flatten(Contours)
end = EndPoints(Curve=contour)  # -> Start, End
devec = DeconstructVector(Vector=end.Start)  # -> XComponent, YComponent, ZComponent
bnd = Bounds(Numbers=devec.ZComponent)
dedomain = DeconstructDomain(Domain=bnd)  # -> Start, End
gradient = Gradient(
    LowerLimit=dedomain.Start,
    UpperLimit=dedomain.End,
    Parameter=devec.ZComponent,
    stops=[0: RGB(21, 166, 208), 0.8: RGB(255, 255, 128), 1: RGB(255, 0, 26)])
previewlw = CustomPreviewLineweights(Geometry=contour, Shader=gradient, Thickness=等高线宽度, Absolute="0")

# ----
# 坡度
mcomp = Decompose(Mesh=mesh地形)  # -> Vertices, Faces, Colours, Normals
Z = UnitZ(Factor=1)
angle = Angle(VectorA=mcomp.Normals, VectorB=Z)  # -> Angle, Reflex
deg = Degrees(Radians=angle.Angle)
bnd_2 = Bounds(Numbers=angle.Angle)
domcomp = DomainComponents(Domain=bnd_2)  # -> Start, End
deg_2 = Degrees(Radians=domcomp.Start)
deg_3 = Degrees(Radians=domcomp.End)
dom = Domain(DomainStart=deg_2, DomainEnd=deg_3)
gradient_2 = Gradient(
    LowerLimit=deg_2,
    UpperLimit=deg_3,
    Parameter=deg,
    stops=[0: RGB(255, 255, 255), 1: RGB(70, 130, 180), 1: RGB(255, 255, 255), 1: RGB(75, 107, 169)])
panel = Panel(dom)
mesh = Mesh(Vertices=mcomp.Vertices, Faces=mcomp.Faces, Colours=gradient_2)
preview = CustomPreview(
    Geometry=mesh,
    Material={diffuse=RGB(221, 160, 221), emission=RGB(66, 48, 66), shine=0.5, specular=RGB(255, 255, 255), transparency=0})

# ----
# 高程
mcomp_2 = Decompose(Mesh=mesh地形)  # -> Vertices, Faces, Colours, Normals
pdecon = Deconstruct(Point=mcomp_2.Vertices)  # -> XComponent, YComponent, ZComponent
bnd_3 = Bounds(Numbers=pdecon.ZComponent)
domcomp_2 = DomainComponents(Domain=bnd_3)  # -> Start, End
gradient_3 = Gradient(
    LowerLimit=domcomp_2.Start,
    UpperLimit=domcomp_2.End,
    Parameter=pdecon.ZComponent,
    stops=[0: RGB(255, 255, 255), 0.384: RGB(135, 206, 235), 1: RGB(70, 130, 180), 1: RGB(255, 255, 255), 1: RGB(75, 107, 169)])
mesh_2 = Mesh(Vertices=mcomp_2.Vertices, Faces=mcomp_2.Faces, Colours=gradient_3)
