# Grasshopper definition 垂直的潮汐.gh (Grasshopper 1.0.5)

等分数量 = Slider(60, range=0..200)
曲线数量 = Slider(3, range=0..10)
扭曲程度 = Slider(2, range=0..5)
杂乱程度 = Slider(0.38, range=0..1)
seed = Slider(553, range=0..1000)
伸出距离 = Slider(3.4, range=0..10)
挤出厚度 = Slider(0.5, range=0..10)
凹陷比例 = Slider(1, range=0..1)
surface = Surface(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)
divide_surface = DivideSurface(Surface=surface, UCount="1", VCount=等分数量)  # -> simplify(Points), Normals, Parameters

series = Series(Start=seed, Step=1, Count=expr("x+1", 扭曲程度))
divide_surface_2 = DivideSurface(Surface=surface, UCount=曲线数量, VCount=扭曲程度)  # -> Points, Normals, Parameters
graft_tree = GraftTree(Tree=series, IncludeEmptyLists=True, IncludeNullItems=True)
flip_matrix = FlipMatrix(Data=divide_surface_2.Points)
jitter = Jitter(List=flip_matrix, Jitter=杂乱程度, Seed=graft_tree)  # -> Values, Indices
flip_matrix_2 = FlipMatrix(Data=jitter.Values)
surface_closest_point = SurfaceClosestPoint(Point=flip_matrix_2, Surface=surface)  # -> Point, UVPoint, Distance
curve_on_surface = CurveOnSurface(Surface=surface, UVCoordinates=surface_closest_point.UVPoint, Closed=False)  # -> simplify(flatten(Curve)), Length, Domain

flip_matrix_3 = FlipMatrix(Data=divide_surface.Points)
polyline = PolyLine(Vertices=flip_matrix_3, Closed=False)
list_item = ListItem(List=simplify(flip_matrix_3), Index=0, Wrap=True)  # -> Item, Item1
curve_curve = CurveCurve(CurveA=curve_on_surface.Curve, CurveB=polyline)  # -> simplify(Points), ParamsA, ParamsB
trim_tree = TrimTree(Tree=curve_curve.Points, Depth=1)
deconstruct = Deconstruct(Point=trim_tree)  # -> XComponent, YComponent, ZComponent
sort_list = SortList(Keys=deconstruct.ZComponent, ValuesValuesA=trim_tree)  # -> Keys, ValuesValuesA
merge = Merge(Data1=list_item.Item, Data2=sort_list.ValuesValuesA, Data3=list_item.Item1)

surface_closest_point_2 = SurfaceClosestPoint(Point=merge, Surface=surface)  # -> Point, UVPoint, Distance
evaluate_surface = EvaluateSurface(Surface=surface, Point=surface_closest_point_2.UVPoint)  # -> Point, Normal, UDirection, VDirection, Frame
amplitude = Amplitude(Vector=evaluate_surface.Normal, Amplitude=伸出距离)
series_2 = Series(Start=0, Step=1, Count=expr("x+3", 曲线数量))
move = Move(Geometry=merge, Motion=amplitude)  # -> Geometry, Transform
list_item_2 = ListItem(List=move.Geometry, Index=series_2, Wrap=True)  # -> graft(Item), graft(Item1)
distance = Distance(PointA=list_item_2.Item, PointB=list_item_2.Item1)
line = Line(StartPoint=list_item_2.Item, EndPoint=list_item_2.Item1)
bounds = Bounds(Numbers=flatten(distance))
point_on_curve = PointOnCurve(line, parameter=0.5)
surface_closest_point_3 = SurfaceClosestPoint(Point=point_on_curve, Surface=surface)  # -> Point, UVPoint, Distance
remap_numbers = RemapNumbers(Value=distance, Source=bounds, Target=伸出距离)  # -> Mapped, Clipped
evaluate_surface_2 = EvaluateSurface(Surface=surface, Point=surface_closest_point_3.UVPoint)  # -> Point, Normal, UDirection, VDirection, Frame
multiplication = Multiplication(A=remap_numbers.Mapped, B=凹陷比例)
amplitude_2 = Amplitude(Vector=evaluate_surface_2.Normal, Amplitude=expr("-x", multiplication))
move_2 = Move(Geometry=point_on_curve, Motion=amplitude_2)  # -> Geometry, Transform
arc_3pt = Arc3Pt(PointA=simplify(list_item_2.Item), PointB=simplify(move_2.Geometry), PointC=simplify(list_item_2.Item1))  # -> Arc, Plane, Radius

trim_tree_2 = TrimTree(Tree=arc_3pt.Arc, Depth=1)
sort_list_2 = SortList(Keys=trim_tree_2, ValuesValuesA=trim_tree_2)  # -> Keys, ValuesValuesA
cull_index = CullIndex(List=sort_list_2.ValuesValuesA, Indices=-1, Wrap=True)
list_item_3 = ListItem(List=evaluate_surface.Normal, Index=0, Wrap=True)
list_item_4 = ListItem(List=evaluate_surface.Point, Index=0, Wrap=True)
join_curves = JoinCurves(Curves=cull_index, Preserve=False)
plane_normal = PlaneNormal(Origin=list_item_4, ZAxis=list_item_3)
project = Project(Geometry=join_curves, Plane=plane_normal)  # -> Geometry, Transform
unit_z = UnitZ(Factor=1)
amplitude_3 = Amplitude(Vector=plane_normal, Amplitude=挤出厚度)
ruled_surface = RuledSurface(CurveA=join_curves, CurveB=project.Geometry)
rotate = Rotate(Vector=amplitude_3, Axis=unit_z, Angle=1.570796327)
extrude = Extrude(Base=ruled_surface, Direction=rotate)

preview = CustomPreview(Geometry=extrude, Material=ColourSwatch(SwatchColor=RGB(255, 255, 255)))
