# Grasshopper definition 城市底图.gh (Grasshopper 1.0.5)
# plug-ins: ElkGHComponents

path = FilePath()
loc = Location(FilePathText=path)  # -> OSMPointData, OSMFile, LongitudeDomain, LatitudeDomain

# ----
# 建筑
osm = OSMData(OSMPointData=loc.OSMPointData, OSMFilePath=loc.OSMFile, Feature="building", Generate3d=False, IndividualOutputs=False)  # -> Ways, FeatureKey
pline = PolyLine(Vertices=osm.Ways, Closed=False)

# ----
# 道路
osm_2 = OSMData(OSMPointData=loc.OSMPointData, OSMFilePath=loc.OSMFile, Feature="highway", Generate3d=False, IndividualOutputs=False)  # -> Ways, FeatureKey
pline_2 = PolyLine(Vertices=osm_2.Ways, Closed=False)

# ----
# 城市边界
osm_3 = OSMData(OSMPointData=loc.OSMPointData, OSMFilePath=loc.OSMFile, Feature="boundary", Generate3d=False, IndividualOutputs=False)  # -> Ways, FeatureKey
pline_3 = PolyLine(Vertices=osm_3.Ways, Closed=False)

# ----
# 河流
osm_4 = OSMData(OSMPointData=loc.OSMPointData, OSMFilePath=loc.OSMFile, Feature="waterway", Generate3d=False, IndividualOutputs=False)  # -> Ways, FeatureKey
pline_4 = PolyLine(Vertices=osm_4.Ways, Closed=False)

# ----
# 铁路
osm_5 = OSMData(OSMPointData=loc.OSMPointData, OSMFilePath=loc.OSMFile, Feature="railway", Generate3d=False, IndividualOutputs=False)  # -> Ways, FeatureKey
pline_5 = PolyLine(Vertices=osm_5.Ways, Closed=False)
