# Grasshopper definition 室外舒适度.gh (Grasshopper 1.0.7)

ladybug = Ladybug_Ladybug()  # -> Vviiiiiiiiiizzz; plug-in component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

# ----
# Import Climate Data for Los Angeles
panel = Panel("https://www.energyplus.net/weather-download/north_and_central_america_wmo_region_4/USA/CA/USA_CA_Burbank-Glendale-Passadena.Bob.Hope.AP.722880_TMY3/all")
epw_stat = Ladybug_OpenEPWAndSTATWeatherFiles(weatherFileURL=panel)  # -> epwFile, statFile; plug-in component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
importepw = Ladybug_ImportEpw(epwFile=epw_stat.epwFile)  # -> readMe, latitude, location, dryBulbTemperature, dewPointTemperature, relativeHumidity, windSpeed, windDirection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; plug-in component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

# ----
# Import Climate Data for New York
panel_2 = Panel("https://www.energyplus.net/weather-download/north_and_central_america_wmo_region_4/USA/NY/USA_NY_New.York-J.F.Kennedy.Intl.AP.744860_TMY3/all")
epw_stat_2 = Ladybug_OpenEPWAndSTATWeatherFiles(weatherFileURL=panel_2)  # -> epwFile, statFile; plug-in component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
importepw_2 = Ladybug_ImportEpw(epwFile=epw_stat_2.epwFile)  # -> readMe, latitude, location, dryBulbTemperature, dewPointTemperature, relativeHumidity, windSpeed, windDirection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; plug-in component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

# ----
# Play With Some Sliders
outdoorcomfortcalculator = Ladybug_OutdoorComfortCalculator(
    dryBulbTemperature=Slider(21, range=0..30),
    windSpeed_tenMeters=Slider(2, range=0..5),
    relativeHumidity=Slider(50, range=0..100),
    runIt=Toggle(True))  # -> readMe, port, universalThermalClimateIndex, comfortableOrNot, thermalStress, conditionOfPerson, port_2, percentOfTimeComfortable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; plug-in component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
panel_3 = Panel(outdoorcomfortcalculator.universalThermalClimateIndex)

# ----
# Calculate Outdoor Comfort for NY
outdoorcomfortcalculator_2 = Ladybug_OutdoorComfortCalculator(
    dryBulbTemperature=importepw_2.dryBulbTemperature,
    windSpeed_tenMeters=importepw_2.windSpeed,
    relativeHumidity=importepw_2.relativeHumidity,
    runIt=Toggle(True))  # -> readMe, port, universalThermalClimateIndex, comfortableOrNot, thermalStress, conditionOfPerson, port_2, percentOfTimeComfortable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; plug-in component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
panel_4 = Panel(outdoorcomfortcalculator_2.percentOfTimeComfortable)

# ----
# Calculate Outdoor Comfort for LA
outdoorcomfortcalculator_3 = Ladybug_OutdoorComfortCalculator(
    dryBulbTemperature=importepw.dryBulbTemperature,
    windSpeed_tenMeters=importepw.windSpeed,
    relativeHumidity=importepw.relativeHumidity,
    runIt=Toggle(True))  # -> readMe, port, universalThermalClimateIndex, comfortableOrNot, thermalStress, conditionOfPerson, port_2, percentOfTimeComfortable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; plug-in component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
panel_5 = Panel(outdoorcomfortcalculator_3.percentOfTimeComfortable)

# ----
# Visualize Comfort In Two Climates
number_slider = Slider(-2, range=-2..2)
legendpar = Ladybug_LegendParameters(lowBound=number_slider, highBound=Slider(2, range=-2..2))  # -> legendPar; plug-in component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
_3dchart = Ladybug_3DChart(
    inputData=flatten([outdoorcomfortcalculator_3.conditionOfPerson, outdoorcomfortcalculator_2.conditionOfPerson]),
    xScale=Slider(0.25, range=0..1),
    zScale=Slider(0, range=0..100),
    legendPar=legendpar)  # -> readMe, graphMesh, graphCurves, legend, legendBasePts, title, titleBasePts, dataPts, conditionalHOY; plug-in component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
preview = CustomPreview(Geometry=[_3dchart.legend, _3dchart.graphCurves], Shader=ColourSwatch(SwatchColor=RGB(0, 0, 0)))
