# Grasshopper definition 室外舒适度EST.gh (Grasshopper 1.0.5)

path = FilePath("D:\Users\Sirius\Desktop\CHN_Qingdao.epw")
起始月份 = Slider(2, range=0..12)
结束月份 = Slider(2, range=0..12)

ladybug = Ladybug_Ladybug()  # -> Vviiiiiiiiiizzz; plug-in component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
importepw = Ladybug_ImportEpw(epwFile=path)  # -> readMe, latitude, location, dryBulbTemperature, dewPointTemperature, relativeHumidity, windSpeed, windDirection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; plug-in component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

# ----
# Visualize Wind Speed
# Variation With Height
number_slider = Slider(50, range=0..100)
windboundaryprofile = Ladybug_WindBoundaryProfile(
    windSpeed_tenMeters=importepw.windSpeed,
    windDirection=importepw.windDirection,
    terrainType=Slider(1, range=0..1),
    originPt="-50,0,0",
    windProfileHeight=number_slider)  # -> readMe, port, windSpeeds, windVectors, vectorAnchorPts, port_2, windVectorMesh, windProfileCurve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; plug-in component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

windspeedcalculator = Ladybug_WindSpeedCalculator(
    windSpeed_tenMeters=importepw.windSpeed,
    windDirection=importepw.windDirection,
    terrainType=Slider(1, range=0..3),
    heightAboveGround="1")  # -> readMe, windSpeedAtHeight, windVectorAtHeight; plug-in component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
activitieslist = Ladybug_ActivitiesMetList({"Sleeping": 0.7, "Reclining": 0.8, "Sitting": 1.0, "Typing": 1.1, "Standing": 1.2, "Driving": 1.5, "Cooking": 1.8, "House Cleaning": 2.7, "Strolling": 1.7, "Walking 2mph": 2.0, "Walking 3mph": 2.6, "Walking 4mph": 3.8, "Running 9mph": 9.5, "Lifting 10lbs": 2.1, "Lifting 100lbs": 4.0, "Shoveling": 4.4, "Dancing": 3.4, "Basketball": 6.3}, selected="Walking 4mph")
analysisperiod = Ladybug_AnalysisPeriod(fromMonth=起始月份, toMonth=结束月份)  # -> readMe, analysisPeriod; disabled; plug-in component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
pmvcomfortcalculator = Ladybug_PMVComfortCalculator(
    dryBulbTemperature=importepw.dryBulbTemperature,
    windSpeed=windspeedcalculator.windSpeedAtHeight,
    relativeHumidity=importepw.relativeHumidity,
    metabolicRate=activitieslist,
    analysisPeriod=analysisperiod.analysisPeriod,
    calcBalanceTemperature=False,
    runIt=Toggle(False))  # -> readMe, port, port_2, port_3, OUT_SET, port_4, restrictedComfOrNot, restrictedPercentComf, port_5, balanceTemperature; plug-in component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
_3dchart = Ladybug_3DChart(inputData=flatten(pmvcomfortcalculator.OUT_SET), xScale="0.25", yScale="0.25", zScale="0")  # -> readMe, graphMesh, graphCurves, legend, legendBasePts, title, titleBasePts, dataPts, conditionalHOY; plug-in component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
