# Grasshopper definition 日照.gh (Grasshopper 1.0.5)
# plug-ins: FalseStartToggle

导入 = FalseStartToggle(False)

指北 = Vector(Vector(0, 50, 0))
日期 = Slider(14, range=0..31)
月份 = Slider(1, range=0..12)

开始运算 = FalseStartToggle(False)

计算物体 = Brep([<brep referenced from the Rhino model> x93])
遮挡物 = Brep([<brep referenced from the Rhino model> x184])

图例分级 = Slider(14, range=0..100)
颜色样式 = Slider(12, range=0..25)
图例缩放 = Slider(0.7, range=0..1)
图里字号 = Slider(0.2, range=0..1)

ladybug = Ladybug_Ladybug()  # -> Vviiiiiiiiiizzz; plug-in component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
open_weather_file = Ladybug_OpenEPWWeatherFile(open=导入)  # -> epwFile; plug-in component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
importepw = Ladybug_ImportEpw(epwFile=open_weather_file)  # -> readMe, latitude, location, dryBulbTemperature, dewPointTemperature, relativeHumidity, windSpeed, windDirection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; plug-in component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
图例分级_2 = Slider(14, range=0..100)
图例缩放_2 = Slider(0.1, range=0..1)
图例字号 = Slider(0.1, range=0..1)
颜色样式_2 = Slider(12, range=0..25)
series = Series(Start=Slider(1, range=0..1), Step=Slider(1, range=0..1), Count=Slider(24, range=0..100))

brep = Brep([<brep referenced from the Rhino model> x91])
brep_2 = Brep([<brep referenced from the Rhino model> x184])
wires = BrepWireframe(Brep=brep_2, Density=-1)
preview = CustomPreview(Geometry=brep, Material=ColourSwatch(SwatchColor=RGB(219, 219, 219)))
preview_2 = CustomPreview(Geometry=wires, Material=ColourSwatch(SwatchColor=RGB(0, 0, 0)))

gradientlibrary = Ladybug_GradientLibrary(gradIndex=颜色样式)  # -> customColors; plug-in component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
legendpar = Ladybug_LegendParameters(numSegments=图例分级_2, customColors=flatten(gradientlibrary), legendScale=图例缩放_2, fontSize=图例字号)  # -> legendPar; plug-in component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
sunpath = Ladybug_SunPath(
    north=指北,
    location=importepw.location,
    hour=series,
    day=日期,
    month=月份,
    timeStep=1,
    sunPathScale=Slider(1, range=0..12),
    legendPar=legendpar,
    dailyOrAnnualSunPath=True)  # -> readMe, sunVectors, sunAltitudes, sunAzimuths, port, sunSpheresMesh, sunPathCrvs, compassCrvs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; plug-in component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

ln = Line(StartPoint=sunpath.sunPathCenPts, EndPoint=sunpath.sunPositions)
loft = Loft(Curves=ln, Options={Adjust=False, Closed=False, LoftEnds=0, LoftSimp=0, LoftType=0, Rebuild=10, Refit=0.01})
preview_3 = CustomPreview(Geometry=loft, Material=ColourSwatch(SwatchColor=RGB(185, 255, 255)))

preview_4 = CustomPreview(Geometry=sunpath.compassCrvs, Material=ColourSwatch(SwatchColor=RGB(0, 0, 0)))

preview_5 = CustomPreview(Geometry=sunpath.sunSpheresMesh, Material=ColourSwatch(SwatchColor=RGB(250, 100, 100)))
preview_6 = CustomPreview(Geometry=sunpath.sunPathCrvs, Material=ColourSwatch(SwatchColor=RGB(255, 148, 148)))
toggle = FalseStartToggle(False)
legendpar_2 = Ladybug_LegendParameters(numSegments=图例分级, customColors=flatten(gradientlibrary), legendScale=图例缩放, fontSize=图里字号)  # -> legendPar; plug-in component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
sunlighthoursanalysis = Ladybug_SunlightHoursAnalysis(
    geometry=flatten(计算物体),
    context=flatten(遮挡物),
    gridSize=Slider(0.1, range=0..1),
    disFromBase=Slider(0.3, range=0..1),
    sunVectors=flatten(sunpath.sunVectors),
    timeStep=1,
    legendPar=flatten(legendpar_2),
    parallel=toggle,
    runIt=开始运算)  # -> readMe, contextMesh, analysisMesh, testPts, testVec, port, sunlightHoursResult, sunlightHoursMesh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; plug-in component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
