# Grasshopper definition 汇水.gh (Grasshopper 1.0.5)
# plug-ins: SonicFlow

srf = Surface(<surface referenced from the Rhino model>)
结果精度 = Slider(40, range=0..100)
计算次数 = Slider(50, range=0..1000)

sdivide = DivideSurface(Surface=srf, UCount=Slider(100, range=0..100), VCount=Slider(60, range=0..100))  # -> Points, Normals, Parameters; disabled
flow = Flow(Surface=srf, Point3D=sdivide.Points, Double=结果精度, Integer=计算次数)
crv = Curve(flow)
end = EndPoints(Curve=crv)  # -> Start, End
devec = DeconstructVector(Vector=end.Start)  # -> XComponent, YComponent, ZComponent
bnd = Bounds(Numbers=devec.ZComponent)
dedomain = DeconstructDomain(Domain=bnd)  # -> Start, End

gradient = Gradient(
    LowerLimit=dedomain.End,
    UpperLimit=dedomain.Start,
    Parameter=devec.ZComponent,
    stops=[0: RGB(91, 152, 245), 1: RGB(135, 206, 250)])
preview = CustomPreview(Geometry=crv, Material=gradient)
