# Grasshopper definition 热点.gh (Grasshopper 1.0.5)
# plug-ins: Human, LunchBox, ElkGHComponents

multiplication = Multiplication(A=Slider(0.3, range=0..1), B=Slider(1, range=0..1000000))

文件路径 = FilePath("D:\Users\Sirius\Desktop\人流\qd.osm")
范围 = Curve(<curve referenced from the Rhino model>)
x轴数量 = Slider(100, range=0..100)
y轴数量 = Slider(100, range=0..100)
圆圈宽度 = Slider(60000, range=0..100000)
缩放 = Slider(0.03, range=0..0.1)

loc = Location(FilePathText=文件路径)  # -> OSMPointData, OSMFile, LongitudeDomain, LatitudeDomain
osm = OSMData(OSMPointData=loc.OSMPointData, OSMFilePath=loc.OSMFile, Feature="natural", Generate3d=False, IndividualOutputs=False)  # -> Ways, FeatureKey
boundary = BoundarySurfaces(Edges=范围)
prune = PruneTree(Tree=osm.Ways, Minimum=Slider(2, range=0..10), Maximum=0)
pline = PolyLine(Vertices=prune, Closed=False)  # -> flatten(Polyline)
quads = QuadPanels(Surface=boundary, UDivisions=x轴数量, VDivisions=y轴数量)
boundary_2 = BoundarySurfaces(Edges=pline)
area = Area(Geometry=boundary_2)  # -> Area, flatten(Centroid)
area_2 = Area(Geometry=quads)  # -> Area, Centroid
pull = PullPoint(Point=area_2.Centroid, Geometry=area.Centroid, ClosestOnly=True)  # -> ClosestPoint, Distance
bnd = Bounds(Numbers=flatten(pull.Distance))
dedomain = DeconstructDomain(Domain=bnd)  # -> Start, End
addition = Addition(A=dedomain.End, B=1)
subtraction = Subtraction(A=addition, B=pull.Distance)
cir = Circle(Plane=area_2.Centroid, Radius=multiplication)
multiplication_2 = Multiplication(A=subtraction, B=缩放)
scale = Scale(Geometry=cir, Center=area_2.Centroid, Factor=multiplication_2)  # -> Geometry, Transform
area_3 = Area(Geometry=scale.Geometry)  # -> Area, Centroid
bnd_2 = Bounds(Numbers=flatten(area_3.Area))
dedomain_2 = DeconstructDomain(Domain=bnd_2)  # -> Start, End

gradient = Gradient(
    LowerLimit=dedomain_2.Start,
    UpperLimit=dedomain_2.End,
    Parameter=area_3.Area,
    stops=[0: RGB(0, 0, 0), 0.139: RGB(3, 141, 255), 0.615: RGB(247, 255, 130), 0.819: RGB(255, 215, 54), 1: RGB(255, 13, 13)])
previewlw = CustomPreviewLineweights(Geometry=scale.Geometry, Shader=gradient, Thickness=圆圈宽度, Absolute=True)
