# Grasshopper definition 热点柱状图.gh (Grasshopper 1.0.5)
# plug-ins: LunchBox, ElkGHComponents

范围 = Curve(<curve referenced from the Rhino model>)
文件路径 = FilePath("D:\Users\Sirius\Desktop\人流\qd.osm")
x轴密度 = Slider(30, range=0..100)
y轴密度 = Slider(30, range=0..100)
底面大小 = Slider(75000, range=0..500000)
boundary = BoundarySurfaces(Edges=范围)
loc = Location(FilePathText=文件路径)  # -> OSMPointData, OSMFile, LongitudeDomain, LatitudeDomain
# ↓Enable↓
quads = QuadPanels(Surface=boundary, UDivisions=x轴密度, VDivisions=y轴密度)  # disabled
# ↓右键选择↓
# ↓建筑类型↓
osm = OSMData(OSMPointData=loc.OSMPointData, OSMFilePath=loc.OSMFile, Feature="shop", Generate3d=False, IndividualOutputs=False)  # -> Ways, FeatureKey
osm_2 = OSMData(OSMPointData=loc.OSMPointData, OSMFilePath=loc.OSMFile, Feature="boundary", Generate3d=False, IndividualOutputs=False)  # -> Ways, FeatureKey
prune = PruneTree(Tree=osm.Ways, Minimum=Slider(3, range=0..10), Maximum=0)
pline = PolyLine(Vertices=osm_2.Ways, Closed=False)
pline_2 = PolyLine(Vertices=prune, Closed=False)  # -> flatten(Polyline)
area = Area(Geometry=quads)  # -> Area, Centroid
# ↓区划参照↓
preview = CustomPreview(Geometry=pline, Material=ColourSwatch(SwatchColor=RGB(0, 0, 0)))
boundary_2 = BoundarySurfaces(Edges=pline_2)
area_2 = Area(Geometry=boundary_2)  # -> Area, flatten(Centroid)
pull = PullPoint(Point=area.Centroid, Geometry=area_2.Centroid, ClosestOnly=True)  # -> ClosestPoint, Distance
planesrf = PlaneSurface(Plane=pline_2, XSize=底面大小, YSize=底面大小)
bnd = Bounds(Numbers=flatten(pull.Distance))
Z = UnitZ(Factor=pull.Distance)
dedomain = DeconstructDomain(Domain=bnd)  # -> Start, End
gradient = Gradient(
    LowerLimit=dedomain.Start,
    UpperLimit=dedomain.End,
    Parameter=pull.Distance,
    stops=[0: RGB(243, 57, 0), 0.1: RGB(236, 27, 60), 0.2: RGB(210, 0, 118), 0.3: RGB(103, 0, 120), 0.4: RGB(39, 72, 161), 0.5: RGB(1, 192, 229), 0.6: RGB(18, 178, 90), 0.7: RGB(79, 186, 8), 0.8: RGB(220, 237, 32), 0.9: RGB(247, 159, 20), 1: RGB(243, 57, 0)])
extr = Extrude(Base=planesrf, Direction=Z)
# ↓Bake↓
preview_2 = CustomPreview(Geometry=extr, Material=gradient)
