# Grasshopper definition 碎片表皮.gh (Grasshopper 1.0.5)
# plug-ins: LunchBox

平面 = Surface(<surface referenced from the Rhino model>)
u方向数量 = Slider(20, range=0..100)
v方向数量 = Slider(20, range=0..100)
随机 = Slider(499, range=0..1000)
角度 = Slider(2.5, range=0..10)
厚度 = Slider(0, range=0..0.1)

staggered_quad_panels = StaggeredQuadPanels(Surface=平面, UDivisions=u方向数量, VDivisions=v方向数量)  # disabled
deconstruct_brep = DeconstructBrep(Brep=staggered_quad_panels)  # -> Faces, Edges, Vertices
point_on_curve = PointOnCurve(deconstruct_brep.Edges, parameter=0.5)
list_item = ListItem(List=deconstruct_brep.Vertices, Index=0, Wrap=True)  # -> Item, Item1, Item2, Item3
list_item_2 = ListItem(List=point_on_curve, Index=0, Wrap=True)  # -> Item, Item1, Item2, Item3
line = Line(StartPoint=list_item.Item, EndPoint=list_item.Item2)
line_2 = Line(StartPoint=list_item.Item1, EndPoint=list_item.Item3)
line_3 = Line(StartPoint=list_item_2.Item, EndPoint=list_item_2.Item2)
line_4 = Line(StartPoint=list_item_2.Item1, EndPoint=list_item_2.Item3)
merge = Merge(Data1=deconstruct_brep.Edges, Data2=line, Data3=line_2, Data4=line_3, Data5=line_4)  # -> simplify(Result)
series = Series(Start=0, Step=1, Count=8)
tree_statistics = TreeStatistics(Tree=merge)  # -> Paths, Length, Count
repeat_data = RepeatData(Data=series, Length=tree_statistics.Count)
graft_tree = GraftTree(Tree=staggered_quad_panels, IncludeEmptyLists=True, IncludeNullItems=True)
jitter = Jitter(List=repeat_data, Jitter=1, Seed=随机)  # -> simplify(graft(Values)), Indices
list_item_3 = ListItem(List=merge, Index=jitter.Values, Wrap=True)
rotate_axis = RotateAxis(Geometry=graft_tree, Angle=degrees(角度), Axis=list_item_3)  # -> Geometry, Transform
boxrec = BoxRectangle(Rectangle=rotate_axis.Geometry, Height=厚度)
wires = BrepWireframe(Brep=boxrec, Density=-1)

preview = CustomPreview(Geometry=wires, Material=ColourSwatch(SwatchColor=RGB(0, 0, 0)))
preview_2 = CustomPreview(Geometry=boxrec, Material=ColourSwatch(SwatchColor=RGB(255, 255, 255)))
