# Grasshopper definition 综合气象信息.gh (Grasshopper 1.0.5)
# plug-ins: Human

# ----
# 导入文件
path = FilePath("E:\Work\大四上\居住区规划\Progress\最终图\CHN_Qingdao.epw")

# ----
# 导入文件
ladybug = Ladybug_Ladybug()  # -> out; plug-in component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
importepw = Ladybug_ImportEpw(epwFile=path)  # -> Output, latitude, location, dryBulbTemperature, dewPointTemperature, relativeHumidity, windSpeed, windDirection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; plug-in component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

# ----
# 画线
外围圆圈半径 = Slider(180, range=0..1000)
轴线线宽 = Slider(2, range=0..10)
轴线线长 = Slider(1300, range=0..2000)
轴线颜色 = ColourSwatch(SwatchColor=RGB(0, 0, 0))

# ----
# 画线
arc = Arc(Plane=PlaneXY(0, 0, 0), Radius=外围圆圈半径, Angle=Domain(0, 4.71238898))  # -> Arc, Length
line = LineSDL(Start=Point(0, 0, 0), Direction=Vector(-1, 0, 0), Length=轴线线长)
line_2 = LineSDL(Start=Point(0, 0, 0), Direction=Vector(0, 1, 0), Length=轴线线长)
line_3 = LineSDL(Start=Point(0, 0, 0), Direction=Vector(1, -1, 0), Length=轴线线长)
deconstruct_arc = DeconstructArc(Arc=arc.Arc)  # -> BasePlane, Radius, Angle
rotate = Rotate(Geometry=arc.Arc, Angle=3.141592654, Plane=PlaneXY(0, 0, 0))  # -> Geometry, Transform
divide_curve = DivideCurve(Curve=rotate.Geometry, Count=365, Kinks=False)  # -> Points, Tangents, Parameters
line_4 = Line(StartPoint=deconstruct_arc.BasePlane, EndPoint=divide_curve.Points)

custom_preview_lineweights = CustomPreviewLineweights(Geometry=[line, line_2, line_3], Shader=轴线颜色, Thickness=轴线线宽, Absolute=False)

# ----
# 温度部分
最低温度 = ColourSwatch(SwatchColor=RGB(231, 143, 255))
最高温度 = ColourSwatch(SwatchColor=RGB(255, 125, 125))
平均温度 = ColourSwatch(SwatchColor=RGB(255, 255, 255))
圆点半径 = Slider(0.7, range=0..1)
区间起点 = Slider(0.15, range=0..1)
区间终点 = Slider(0.7, range=0..1)
等温线 = ColourSwatch(SwatchColor=RGB(0, 0, 0))
等温线起始 = Slider(20, range=0..100)
等温线温差 = Slider(13, range=0..100)
等温线个数 = Slider(9, range=0..50)

# ----
# 温度部分
branchdatadailymonthlyhourly = Ladybug_BranchData(data=importepw.dryBulbTemperature)  # -> dataEachDayOfYear, dataEachMonth, dataEachHourOfDay; plug-in component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
strnum = Ladybug_SeparateData(inputList=flatten(importepw.dryBulbTemperature))  # -> numbers, strings; plug-in component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
selectandaveragedata = Ladybug_AverageData(annualHourlyData=importepw.dryBulbTemperature)  # -> readMe, selHourlyData, averagedDaily, averagedMonthly, avrMonthlyPerHour, avrAnalysisPeriod; plug-in component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
bounds = Bounds(Numbers=branchdatadailymonthlyhourly.dataEachDayOfYear)  # -> flatten(Domain)
bounds_2 = Bounds(Numbers=strnum.numbers)
strnum_2 = Ladybug_SeparateData(inputList=flatten(selectandaveragedata.averagedDaily))  # -> numbers, strings; plug-in component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
construct_domain = ConstructDomain(DomainStart=区间起点, DomainEnd=区间终点)
deconstruct_domain = DeconstructDomain(Domain=bounds)  # -> Start, End
remap_numbers = RemapNumbers(Value=deconstruct_domain.Start, Source=bounds_2, Target=construct_domain)  # -> Mapped, Clipped
remap_numbers_2 = RemapNumbers(Value=deconstruct_domain.End, Source=bounds_2, Target=construct_domain)  # -> Mapped, Clipped
remap_numbers_3 = RemapNumbers(Value=strnum_2.numbers, Source=bounds_2, Target=construct_domain)  # -> Mapped, Clipped
series = Series(Start=等温线起始, Step=等温线温差, Count=等温线个数)
evaluate_curve = EvaluateCurve(Curve=line_4, Parameter=remap_numbers.Mapped)  # -> Point, Tangent, Angle
evaluate_curve_2 = EvaluateCurve(Curve=line_4, Parameter=remap_numbers_2.Mapped)  # -> Point, Tangent, Angle
evaluate_curve_3 = EvaluateCurve(Curve=line_4, Parameter=remap_numbers_3.Mapped)  # -> Point, Tangent, Angle
arc_2 = Arc(Plane=PlaneXY(0, 0, 0), Radius=series, Angle=Domain(0, 4.71238898))  # -> Arc, Length
circle = Circle(Plane=evaluate_curve.Point, Radius=圆点半径)
circle_2 = Circle(Plane=evaluate_curve_2.Point, Radius=圆点半径)
circle_3 = Circle(Plane=evaluate_curve_3.Point, Radius=圆点半径)
rotate_2 = Rotate(Geometry=arc_2.Arc, Angle=3.141592654, Plane=PlaneXY(0, 0, 0))  # -> Geometry, Transform
boundary_surfaces = BoundarySurfaces(Edges=circle)
boundary_surfaces_2 = BoundarySurfaces(Edges=circle_2)
boundary_surfaces_3 = BoundarySurfaces(Edges=circle_3)

custom_preview = CustomPreview(Geometry=boundary_surfaces, Shader=最低温度)
custom_preview_2 = CustomPreview(Geometry=boundary_surfaces_2, Shader=最高温度)
custom_preview_3 = CustomPreview(Geometry=boundary_surfaces_3, Shader=平均温度)
custom_preview_4 = CustomPreview(Geometry=rotate_2.Geometry, Shader=等温线)

# ----
# 太阳辐射
圆心间距 = Slider(5, range=0..10)
圆点半径_2 = Slider(0.8, range=0..1)
区间起点_2 = Slider(1, range=0..1)
区间终点_2 = Slider(0.7, range=0..1)
太阳辐射 = ColourSwatch(SwatchColor=RGB(255, 178, 0))

# ----
# 太阳辐射
selectandaveragedata_2 = Ladybug_AverageData(annualHourlyData=importepw.directNormalRadiation)  # -> readMe, selHourlyData, averagedDaily, averagedMonthly, avrMonthlyPerHour, avrAnalysisPeriod; plug-in component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
strnum_3 = Ladybug_SeparateData(inputList=flatten(selectandaveragedata_2.averagedDaily))  # -> numbers, strings; plug-in component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
bounds_3 = Bounds(Numbers=strnum_3.numbers)
construct_domain_2 = ConstructDomain(DomainStart=区间起点_2, DomainEnd=区间终点_2)
remap_numbers_4 = RemapNumbers(Value=strnum_3.numbers, Source=bounds_3, Target=construct_domain_2)  # -> Mapped, Clipped
end_points = EndPoints(Curve=line_4)  # -> Start, End
evaluate_curve_4 = EvaluateCurve(Curve=line_4, Parameter=remap_numbers_4.Mapped)  # -> Point, Tangent, Angle
point = Point(end_points.End)
line_5 = Line(StartPoint=point, EndPoint=evaluate_curve_4.Point)
divide_distance = DivideDistance(Curve=line_5, Distance=圆心间距)  # -> Points, Tangents, Parameters
circle_4 = Circle(Plane=divide_distance.Points, Radius=圆点半径_2)
cull_index = CullIndex(List=circle_4, Indices=0, Wrap=True)
boundary_surfaces_4 = BoundarySurfaces(Edges=cull_index)

custom_preview_5 = CustomPreview(Geometry=boundary_surfaces_4, Shader=太阳辐射)

# ----
# 相对湿度
线条宽度 = Slider(2, range=0..10)
湿度长度 = Slider(1, range=0..1)
相对湿度 = ColourSwatch(SwatchColor=RGB(77, 232, 178))

# ----
# 相对湿度
selectandaveragedata_3 = Ladybug_AverageData(annualHourlyData=importepw.relativeHumidity)  # -> readMe, selHourlyData, averagedDaily, averagedMonthly, avrMonthlyPerHour, avrAnalysisPeriod; plug-in component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
strnum_4 = Ladybug_SeparateData(inputList=flatten(selectandaveragedata_3.averagedDaily))  # -> numbers, strings; plug-in component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
multiplication = Multiplication(A=strnum_4.numbers, B=湿度长度)
line_sdl = LineSDL(Start=divide_curve.Points, Direction=line_4, Length=multiplication)

custom_preview_lineweights_2 = CustomPreviewLineweights(Geometry=line_sdl, Shader=相对湿度, Thickness=线条宽度, Absolute=False)

# ----
# 风速
风速1 = Slider(5, range=0..100)
风速2 = Slider(10, range=0..20)
圆点半径_3 = Slider(1.5, range=0..10)

# ----
# 风速
selectandaveragedata_4 = Ladybug_AverageData(annualHourlyData=importepw.windSpeed)  # -> readMe, selHourlyData, averagedDaily, averagedMonthly, avrMonthlyPerHour, avrAnalysisPeriod; plug-in component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
strnum_5 = Ladybug_SeparateData(inputList=flatten(selectandaveragedata_4.averagedDaily))  # -> numbers, strings; plug-in component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
multiplication_2 = Multiplication(A=strnum_5.numbers, B=风速1)
multiplication_3 = Multiplication(A=strnum_5.numbers, B=风速2)
line_sdl_2 = LineSDL(Start=divide_curve.Points, Direction=line_4, Length=multiplication_2)
bounds_4 = Bounds(Numbers=strnum_5.numbers)
deconstruct_domain_2 = DeconstructDomain(Domain=bounds_4)  # -> Start, End
end_points_2 = EndPoints(Curve=line_sdl_2)  # -> Start, End
line_sdl_3 = LineSDL(Start=end_points_2.End, Direction=line_4, Length=multiplication_3)
end_points_3 = EndPoints(Curve=line_sdl_3)  # -> Start, End
line_6 = Line([line_sdl_3, line_sdl_2])
vlen = VectorLength(Vector=line_6)
circle_5 = Circle(Plane=end_points_3.End, Radius=圆点半径_3)
bounds_5 = Bounds(Numbers=vlen)
boundary_surfaces_5 = BoundarySurfaces(Edges=circle_5)
deconstruct_domain_3 = DeconstructDomain(Domain=bounds_5)  # -> Start, End

gradient = Gradient(
    LowerLimit=deconstruct_domain_3.Start,
    UpperLimit=deconstruct_domain_3.End,
    Parameter=vlen,
    stops=[0.15: RGB(176, 225, 255), 0.85: RGB(101, 174, 219)])
gradient_2 = Gradient(
    LowerLimit=deconstruct_domain_2.Start,
    UpperLimit=deconstruct_domain_2.End,
    Parameter=strnum_5.numbers,
    stops=[0: RGB(0, 128, 0), 0.5: RGB(255, 255, 0), 1: RGB(255, 0, 0)])
custom_preview_6 = CustomPreview(Geometry=line_6, Shader=gradient)

custom_preview_7 = CustomPreview(Geometry=boundary_surfaces_5, Shader=gradient_2)
