# Grasshopper definition 风玫瑰.gh (Grasshopper 1.0.5)
# plug-ins: FalseStartToggle

导入epw文件 = FalseStartToggle(True)
起始月份 = Slider(1, range=0..1)
最后月份 = Slider(12, range=0..100)
缩放比例 = Slider(0.001, range=0..0.011)
格子尺寸 = Slider(725, range=0..1000)
x轴数量 = Slider(3, range=0..10)
y轴数量 = Slider(2, range=0..10)
配色 = Slider(15, range=0..100)
半径 = Slider(20, range=0..100)
开始运算 = FalseStartToggle(True)
sqgrid = Square(Plane=PlaneXY(0, 0, 0), Size=格子尺寸, ExtentX=x轴数量, ExtentY=y轴数量)  # -> Cells, Points
series = Series(Start=起始月份, Step=1, Count=最后月份)
rev = ReverseList(List=sqgrid.Points)
ladybug = Ladybug_Ladybug()  # -> Vviiiiiiiiiizzz; plug-in component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
open_weather_file = Ladybug_OpenEPWWeatherFile(open=导入epw文件)  # -> epwFile; plug-in component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
flip = FlipMatrix(Data=sqgrid.Points)
analysisperiod = Ladybug_AnalysisPeriod(fromMonth=series, toMonth=series)  # -> readMe, analysisPeriod; plug-in component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
gradientlibrary = Ladybug_GradientLibrary(gradIndex=配色)  # -> customColors; plug-in component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
flatten = FlattenTree(Tree=flip, Path="{0}")  # -> graft(Tree)
importepw = Ladybug_ImportEpw(epwFile=open_weather_file)  # -> readMe, latitude, location, dryBulbTemperature, dewPointTemperature, relativeHumidity, windSpeed, windDirection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; plug-in component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
legendpar = Ladybug_LegendParameters(customColors=flatten(gradientlibrary))  # -> legendPar; plug-in component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
windrose = Ladybug_WindRose(
    north=0,
    hourlyWindDirection=importepw.windDirection,
    hourlyWindSpeed=importepw.windSpeed,
    analysisPeriod=analysisperiod.analysisPeriod,
    centerPoint=flatten,
    maxFrequency=半径,
    scale=缩放比例,
    legendPar=legendpar,
    runIt=开始运算)  # -> readMe, calmRoseMesh, windRoseMesh, windRoseCrvs, windRoseCenPts, legend, legendBasePts, title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; plug-in component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
geo = Geometry([windrose.legend, windrose.title, windrose.windRoseCrvs, windrose.windRoseMesh])
preview = CustomPreview(Geometry=geo, Material=ColourSwatch(SwatchColor=RGB(0, 0, 0)))
