# Grasshopper definition 高层.gh (Grasshopper 1.0.5)
# plug-ins: LunchBox

number_slider = Slider(4, range=0..100)
number_slider_2 = Slider(30, range=0..100)
diamond = DiamondPanels(UDivisions=10, VDivisions=10)  # -> DiamondPanels, TriPanels
srf = Surface(<surface referenced from the Rhino model>)
diagrid = DiagridStructure(Surface=srf, UDivisions=Slider(12, range=0..100), VDivisions=Slider(60, range=0..100), Type=True)  # -> StructureLines, StructureNodes
number_slider_3 = Slider(-0.6, range=-2..0)
number_slider_4 = Slider(0.1, range=0..0.1)
Z = UnitZ(Factor=Slider(0.1, range=0..0.1))
extr = Extrude(Base=diagrid.StructureLines, Direction=Z)
Y = UnitY(Factor=Slider(0.05, range=0..0.1))
extr_2 = Extrude(Base=extr, Direction=Y)
