# Grasshopper definition 高程plus.gh (Grasshopper 1.0.5)

# ----
# ↓调整密度↓
地形曲面 = Surface(<surface referenced from the Rhino model>)
x轴格子数量 = Slider(40, range=0..100)
y轴格子数量 = Slider(30, range=0..100)
格子大小 = Slider(3, range=0..10)
边线粗细 = Slider(0.7, range=0..1)

sdivide = DivideSurface(Surface=地形曲面, UCount=x轴格子数量, VCount=y轴格子数量)  # -> Points, Normals, Parameters
neg = Negative(Value=格子大小)
dom = ConstructDomain(DomainStart=neg, DomainEnd=格子大小)
devec = DeconstructVector(Vector=sdivide.Points)  # -> XComponent, YComponent, ZComponent
planesrf = PlaneSurface(Plane=sdivide.Points, XSize=dom, YSize=dom)
scale = Scale(Geometry=planesrf, Center=sdivide.Points, Factor=边线粗细)  # -> Geometry, Transform
bnd = Bounds(Numbers=devec.ZComponent)
offset = OffsetSurface(Surface=scale.Geometry, Distance=1, Retrim=True)
dedomain = DeconstructDomain(Domain=bnd)  # -> Start, End

gradient = Gradient(
    LowerLimit=dedomain.Start,
    UpperLimit=dedomain.End,
    Parameter=devec.ZComponent,
    stops=[0: RGB(21, 166, 208), 0.753: RGB(255, 255, 128), 1: RGB(255, 0, 26)])
# ↓调整颜色↓
swatch = ColourSwatch(SwatchColor=RGB(255, 255, 255))

# ----
# ↓Bake这两个↓
preview = CustomPreview(Geometry=planesrf, Material=gradient)
preview_2 = CustomPreview(Geometry=offset, Material=swatch)
